# Grasshopper definition aula_1.gh (Grasshopper 0.9.76)

# https://www.youtube.com/watch?v=pFCrIzENDn8&list=PLapoQ_9M-ujfYGOsZProIXPGx-HRfjJ9C
# 
# parada 1:30
number_slider = Slider(1, range=0..1)
pt = Point([Point(-1, 6, 0), Point(2, 6, 0), Point(-1, 1, 0), Point(-1, -2, 0), Point(2, -3, 0), Point(1, -5, 0), Point(6, -4, 0), Point(4, -6, 0)])
c_script = CSharpScript(x=number_slider, y=Slider(2, range=0..2), z=Slider(1, range=0..1))  # -> out, A, B; inputs x: Double, y: Double, z: Double
# ---------- c_script: C# ----------
    //Point3d myPoint = new Point3d(1.0, 2.0, 3.0);
    //A = myPoint;

    //if (x > y)
    //{
    //  Print("x is bigger than y");
    //  Print("y is smaller than x");
    //}
    //else
    //{
    //  Print("x is smaller than y");
    //  Print("y is bigger than x");
    //}

    for (int i = 0; i < 5; i++)
    {
      Print(i.ToString());
      RhinoApp.WriteLine("Hello World"); //imprime no rhino
    }
# ---------- end c_script ----------
c_script_2 = CSharpScript(points=pt)  # -> out, A; inputs points: list of Point3d
# ---------- c_script_2: C# ----------
    List<Circle> circles = new List<Circle>();

    foreach (Point3d point in points)
    {
      Circle circle = new Circle(point, 2.0);
    }
# ---------- end c_script_2 ----------
c_script_3 = CSharpScript()  # -> out, A
# ---------- c_script_3: C# ----------
    List<Point3d> myPoints = new List<Point3d> ();

    //myPoints.Add(new Point3d(1.0, 2.0, 3.0));
    //myPoints.Add(new Point3d(2.0, 3.0, 4.0));

    for (int i = 0; i < 100; i++)
    {
      Point3d point = new Point3d(i, i, i);
      myPoints.Add(point);
    }

    A = myPoints;
# ---------- end c_script_3 ----------
c_script_4 = CSharpScript()  # -> out, A
# ---------- c_script_4: C# ----------
    List<Point3d> myPoints = new List<Point3d> ();

    //myPoints.Add(new Point3d(1.0, 2.0, 3.0));
    //myPoints.Add(new Point3d(2.0, 3.0, 4.0));

    for (int i = 0; i < 100; i++)
    {
      for (int j = 0; j < 20; j++)
      {
        myPoints.Add(new Point3d(i, j, 0));
      }
    }

    A = myPoints;
# ---------- end c_script_4 ----------
panel = Panel(c_script.out)
panel_2 = Panel(c_script.A)
panel_3 = Panel(c_script_2.out)
